# Grasshopper definition trial01-agg-wasp-for-hops.gh (Grasshopper 1.0.7)

# ---- group: RH_IN:seed
number_slider = Slider(87, range=0..100)

# ---- group: RH_IN:numberofparts
number_slider_2 = Slider(85, range=0..100)

# ---- group: RH_IN:meshsubD
number_slider_3 = Slider(1, range=0..1)

# ---- group: RH_IN:reset
boolean_toggle = BooleanToggle(True)

# ----
point = Point([Point(-2.25, -1.299038106, 1.5), Point(2.25, -1.299038106, 1.5), Point(0, 2.598076211, 1.5)])
geometry = Geometry(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)
curve = Curve([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])
point_2 = Point([Point(7, 12.09807621, 6), Point(7, 9.098076211, 0), Point(7, 4.598076211, 1.5)])
curve_2 = Curve([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])
geometry_2 = Geometry(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)
point_3 = Point([Point(0, 15.19615238, -1.723270457e-07), Point(0, 6.598076211, 1.5), Point(0, 10.14711429, -0.7500000725), Point(0, 11.6471143, 2.2499999)])
geometry_3 = Geometry(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)
curve_3 = Curve([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])
point_list = PointList(Points=point, Size=Slider(0.53, range=0..1))
point_list_2 = PointList(Points=point_2, Size=Slider(0.53, range=0..1))
point_list_3 = PointList(Points=point_3, Size=Slider(0.53, range=0..1))
subd = SubD(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)
subd_2 = SubD(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)
subd_3 = SubD(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)
conndir = Wasp_ConnectionFromDirection(GEO=geometry, CEN=point, UP=curve)  # -> CONN, PLN_OUT; inputs CEN: list of Point3d, UP: list of Curve, T: list; plug-in component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
subd_control_polygon = SubDControlPolygon(SubD=subd)
conndir_2 = Wasp_ConnectionFromDirection(GEO=geometry_2, CEN=point_2, UP=curve_2)  # -> CONN, PLN_OUT; inputs CEN: list of Point3d, UP: list of Curve, T: list; plug-in component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
subd_control_polygon_2 = SubDControlPolygon(SubD=subd_2)
subd_control_polygon_3 = SubDControlPolygon(SubD=subd_3)
conndir_3 = Wasp_ConnectionFromDirection(GEO=geometry_3, CEN=point_3, UP=curve_3)  # -> CONN, PLN_OUT; inputs CEN: list of Point3d, UP: list of Curve, T: list; plug-in component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
attribute = Wasp_Attribute(ID="detailed-1", VAL=subd_control_polygon, TR=Toggle(True))  # -> ATTR; inputs VAL: list, TR: Boolean; plug-in component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
attribute_2 = Wasp_Attribute(ID="detailed-3", VAL=subd_control_polygon_2, TR=Toggle(True))  # -> ATTR; inputs VAL: list, TR: Boolean; plug-in component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
attribute_3 = Wasp_Attribute(ID="detailed-2", VAL=subd_control_polygon_3, TR=Toggle(True))  # -> ATTR; inputs VAL: list, TR: Boolean; plug-in component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
part = Wasp_BasicPart(NAME="HEXA", GEO=geometry, CONN=flatten(conndir.CONN), ATTR=attribute)  # -> PART; inputs GEO: Mesh, CONN: list, ATTR: list; plug-in component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
part_2 = Wasp_BasicPart(NAME="L", GEO=geometry_2, CONN=flatten(conndir_2.CONN), ATTR=attribute_3)  # -> PART; inputs GEO: Mesh, CONN: list, ATTR: list; plug-in component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
part_3 = Wasp_BasicPart(NAME="jagged", GEO=geometry_3, CONN=flatten(conndir_3.CONN), ATTR=attribute_2)  # -> PART; inputs GEO: Mesh, CONN: list, ATTR: list; plug-in component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
merge = Merge(Data1=part, Data2=part_2, Data3=part_3)
rulegen = Wasp_RulesGenerator(PART=merge)  # -> R; inputs PART: list, SELF_P: Boolean, SELF_C: Boolean, TYP: Boolean, GR: list; plug-in component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
number_of_parts = GetInteger(number_slider_2, AtLeast=1, AtMost=1, Maximum=2147483647, Minimum=-2147483648, Prompt="Integer: 0 to 100")
seed = GetInteger(number_slider, AtLeast=1, AtMost=1, Maximum=2147483647, Minimum=-2147483648, Prompt="Integer: 0 to 100")
reset = GetBoolean(boolean_toggle, AtLeast=1, AtMost=1, FalseValue="False", Prompt="boolean toggle", TrueValue="True")
stochasticaggregation = Wasp_StochasticAggregation(PART=flatten(merge), N=number_of_parts, RULES=rulegen, SEED=seed, RESET=reset)  # -> AGGR, PART_OUT; inputs PART: list, PREV: list, N: Int32, RULES: list, SEED: Int32, MODE: Int32, GC: list, RESET: Boolean; plug-in component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
namefilter = Wasp_FilterPartsByName(PART=stochasticaggregation.PART_OUT, NAME="HEXA")  # -> PART_OUT, MASK; inputs PART: list, NAME: list; plug-in component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
namefilter_2 = Wasp_FilterPartsByName(PART=stochasticaggregation.PART_OUT, NAME="L")  # -> PART_OUT, MASK; inputs PART: list, NAME: list; plug-in component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
namefilter_3 = Wasp_FilterPartsByName(PART=stochasticaggregation.PART_OUT, NAME="jagged")  # -> PART_OUT, MASK; inputs PART: list, NAME: list; plug-in component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
getattr = Wasp_GetAttributeByName(PART=namefilter_2.PART_OUT, ID="detailed-2")  # -> VAL; plug-in component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
partgeo = Wasp_GetPartGeometry(PART=namefilter_2.PART_OUT)  # -> GEO; plug-in component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
partgeo_2 = Wasp_GetPartGeometry(PART=namefilter_3.PART_OUT)  # -> GEO; plug-in component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
getattr_2 = Wasp_GetAttributeByName(PART=namefilter_3.PART_OUT, ID="detailed-3")  # -> VAL; plug-in component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
partgeo_3 = Wasp_GetPartGeometry(PART=namefilter.PART_OUT)  # -> GEO; plug-in component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
getattr_3 = Wasp_GetAttributeByName(PART=namefilter.PART_OUT, ID="detailed-1")  # -> VAL; plug-in component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
mesh_subd = GetInteger(number_slider_3, AtLeast=1, AtMost=1, Maximum=2147483647, Minimum=-2147483648, Prompt="Integer: 0 and 1")
subd_from_mesh = SubDFromMesh(Mesh=getattr, Creases=1, Corners=1, Interpolate=False)  # -> flatten(SubD)
subd_from_mesh_2 = SubDFromMesh(Mesh=getattr_3, Creases=1, Corners=1, Interpolate=False)  # -> flatten(SubD)
subd_from_mesh_3 = SubDFromMesh(Mesh=getattr_2, Creases=1, Corners=1, Interpolate=False)  # -> flatten(SubD)
stream_filter = StreamFilter(Gate=mesh_subd, Stream0=partgeo, Stream1=subd_from_mesh)
stream_filter_2 = StreamFilter(Gate=mesh_subd, Stream0=partgeo_2, Stream1=subd_from_mesh_3)
stream_filter_3 = StreamFilter(Gate=mesh_subd, Stream0=partgeo_3, Stream1=subd_from_mesh_2)
custom_preview = CustomPreview(Geometry=stream_filter_2, Material=ColourSwatch(SwatchColor=RGB(0, 224, 64)))
custom_preview_2 = CustomPreview(Geometry=stream_filter_3, Material=ColourSwatch(SwatchColor=RGB(18, 204, 255)))
custom_preview_3 = CustomPreview(Geometry=stream_filter, Material=ColourSwatch(SwatchColor=RGB(255, 204, 18)))

# ---- group: RH_OUT:geo_2
geometry_4 = Geometry(stream_filter)

# ---- group: RH_OUT:geo_3
geometry_5 = Geometry(stream_filter_2)

# ---- group: RH_OUT:geo_1
geometry_6 = Geometry(stream_filter_3)

# ----
context_bake = ContextBake(Geometry3=geometry_5)
context_bake_2 = ContextBake(Geometry2=geometry_4)
context_bake_3 = ContextBake(Geometry1=geometry_6)
